# Grasshopper definition terrain_node.gh (Grasshopper 1.0.7)
# plug-ins: Docofossor, Kangaroo Components, Section To XY

analyze = Slider(2, range=0..2)
# D:\ARQUITECTURA\00. Diseño Computacional\01. Cartografias\01. Proyectos\Embalse de Alarcon\MDT200\PNOA_MDT200_ETRS89_HU30_Madrid.asc
count = Slider(5, range=2..20)
analyze_2 = GetNumber(analyze, AtLeast=1, AtMost=1, Maximum=1.797693135e+308, Minimum=-1.797693135e+308)
inputtext = GetString(AtLeast=1, AtMost=2147483647)
count_2 = GetNumber(count, AtLeast=1, AtMost=1, Maximum=1.797693135e+308, Minimum=-1.797693135e+308)
import_asc = ImportASC(F=inputtext, N=count_2)
construct_point = ConstructPoint(XCoordinate=0, YCoordinate=0, ZCoordinate=0)
grid_shift = GridShift(Df=import_asc)
grid_mesh = GridMesh(Df=grid_shift)
scale = Scale(Geometry=grid_mesh, Center=construct_point, Factor="0.01")  # -> Geometry, Transform
area = Area(Geometry=scale.Geometry)  # -> Area, Centroid
vector_2pt = Vector2Pt(PointA=area.Centroid, PointB=construct_point, Unitize=False)  # -> Vector, Length
move = Move(Geometry=scale.Geometry, Motion=vector_2pt.Vector)  # -> Geometry, Transform
combine_clean = CombineClean(Meshes=move.Geometry)
concavity = Concavity(Mesh=combine_clean)  # -> Mesh, Colors, Tags, Concavity
roughness = Roughness(Mesh=combine_clean)  # -> Mesh, Colors, Tags, Roughness
elev = Elev(Mesh=combine_clean)  # -> Mesh, Colors, Tags
stream_filter = StreamFilter(Gate=analyze_2, Stream0=concavity.Mesh, Stream1=elev.Mesh, Stream2=roughness.Mesh)

# ---- group: RH_OUT:Terrain
mesh = Mesh(stream_filter)
