# Grasshopper definition terrain_node.gh (Grasshopper 1.0.7)
# plug-ins: Docofossor

resolution = Slider(20, range=2..20)
resolution_2 = GetNumber(resolution, AtLeast=1, AtMost=1, Maximum=1.797693135e+308, Minimum=-1.797693135e+308)
terrain = GetString(AtLeast=1, AtMost=2147483647)
import_asc = ImportASC(F=terrain, N=resolution_2)
grid_shift = GridShift(Df=import_asc)
grid_mesh = GridMesh(Df=grid_shift)

# ---- group: RH_OUT:Terrain
mesh = Mesh(grid_mesh)
